# Grasshopper definition LBI_GlowNetwork.gh (Grasshopper 1.0.7)
# plug-ins: LunchBox, Weaverbird, Kangaroo2 Components

panel = Panel("""54 nodes
78 links""")

cmyk = ColourCMYK(Cyan=Slider(1, range=0..1), Magenta=Slider(0, range=0..1), Yellow=Slider(1, range=0..1), Key=0)

pt_volumecenter = Point(Point(11990.18852, -1033.000011, 413.0943469))
pt_netpartners = Point(<point referenced from the Rhino model>)
pt_partnerorga = Point(<point referenced from the Rhino model>)
pt_spinoffs = Point(<point referenced from the Rhino model>)
pt_peter = Point(<point referenced from the Rhino model>)
pt_andre = Point(<point referenced from the Rhino model>)
pt_stefanthurner = Point(Point(11990.18851, -1347.607665, 1042.309691))
pt_julia = Point(<point referenced from the Rhino model>)
pt_andreas = Point(<point referenced from the Rhino model>)
pt_barbara = Point(<point referenced from the Rhino model>)
pt_joelf = Point(<point referenced from the Rhino model>)
pt_sab = Point(<point referenced from the Rhino model>)
pt_alexander = Point(<point referenced from the Rhino model>)
pt_jörg = Point(<point referenced from the Rhino model>)
pt_michel = Point(<point referenced from the Rhino model>)
pt_philipp = Point(<point referenced from the Rhino model>)
pt_yimin = Point(<point referenced from the Rhino model>)
pt_ines = Point(<point referenced from the Rhino model>)
pt_joelh = Point(<point referenced from the Rhino model>)
pt_mathilde = Point(<point referenced from the Rhino model>)
pt_paulina = Point(<point referenced from the Rhino model>)
pt_spirchman = Point(<point referenced from the Rhino model>)
pt_sebastiand = Point(<point referenced from the Rhino model>)
pt_toastee = Point(<point referenced from the Rhino model>)
pt_simon = Point(<point referenced from the Rhino model>)
pt_arndt = Point(<point referenced from the Rhino model>)
pt_ariadna = Point(<point referenced from the Rhino model>)
pt_daniel = Point(<point referenced from the Rhino model>)
pt_annette = Point(<point referenced from the Rhino model>)
pt_cristian = Point(<point referenced from the Rhino model>)
pt_emma = Point(<point referenced from the Rhino model>)
pt_iva = Point(<point referenced from the Rhino model>)
pt_chris = Point(<point referenced from the Rhino model>)
pt_zuzanna = Point(<point referenced from the Rhino model>)
pt_varun = Point(<point referenced from the Rhino model>)
pt_ernesto = Point(<point referenced from the Rhino model>)
pt_chloé = Point(<point referenced from the Rhino model>)
pt_felix = Point(<point referenced from the Rhino model>)
pt_shrestha = Point(<point referenced from the Rhino model>)
pt_tamas = Point(<point referenced from the Rhino model>)
pt_aryan = Point(<point referenced from the Rhino model>)
pt_inchi = Point(<point referenced from the Rhino model>)
pt_enes = Point(<point referenced from the Rhino model>)
pt_maissa = Point(<point referenced from the Rhino model>)
pt_parijat = Point(<point referenced from the Rhino model>)
pt_iker = Point(<point referenced from the Rhino model>)
pt_pauline = Point(<point referenced from the Rhino model>)
pt_marlene = Point(<point referenced from the Rhino model>)
pt_celine = Point(<point referenced from the Rhino model>)
pt_martin = Point(<point referenced from the Rhino model>)
pt_samir = Point(<point referenced from the Rhino model>)
pt_lisa = Point(<point referenced from the Rhino model>)
pt_clemens = Point(<point referenced from the Rhino model>)
tag = TextTag(Location=pt_netpartners, Text="NetworkPartners", Colour=cmyk)
tag_2 = TextTag(Location=pt_peter, Text="Peter", Colour=cmyk)
tag_3 = TextTag(Location=pt_spinoffs, Text="Spinoff", Colour=cmyk)
tag_4 = TextTag(Location=pt_partnerorga, Text="PartnerOrganizations", Colour=cmyk)
tag_5 = TextTag(Location=pt_julia, Text="Julia", Colour=cmyk)
tag_6 = TextTag(Location=pt_barbara, Text="Barbara", Colour=cmyk)
tag_7 = TextTag(Location=pt_sab, Text="SAB", Colour=cmyk)
tag_8 = TextTag(Location=pt_andreas, Text="Andreas", Colour=cmyk)
tag_9 = TextTag(Location=pt_toastee, Text="Toastee", Colour=cmyk)
tag_10 = TextTag(Location=pt_mathilde, Text="Mathilde", Colour=cmyk)
tag_11 = TextTag(Location=pt_paulina, Text="Paulina", Colour=cmyk)
tag_12 = TextTag(Location=pt_ines, Text="Ines", Colour=cmyk)
tag_13 = TextTag(Location=pt_philipp, Text="Philipp", Colour=cmyk)
tag_14 = TextTag(Location=pt_joelh, Text="JoelH", Colour=cmyk)
tag_15 = TextTag(Location=pt_michel, Text="Michel", Colour=cmyk)
tag_16 = TextTag(Location=pt_chris, Text="Chris", Colour=cmyk)
tag_17 = TextTag(Location=pt_emma, Text="Emma", Colour=cmyk)
tag_18 = TextTag(Location=pt_spirchman, Text="Spirchman", Colour=cmyk)
tag_19 = TextTag(Location=pt_inchi, Text="Inchi", Colour=cmyk)
tag_20 = TextTag(Location=pt_daniel, Text="Daniel", Colour=cmyk)
tag_21 = TextTag(Location=pt_chloé, Text="Chloe", Colour=cmyk)
tag_22 = TextTag(Location=pt_cristian, Text="Cristian", Colour=cmyk)
tag_23 = TextTag(Location=pt_enes, Text="Enes", Colour=cmyk)
tag_24 = TextTag(Location=pt_varun, Text="Varun", Colour=cmyk)
tag_25 = TextTag(Location=pt_celine, Text="Celine", Colour=cmyk)
tag_26 = TextTag(Location=pt_zuzanna, Text="Zuzanna", Colour=cmyk)
tag_27 = TextTag(Location=pt_sebastiand, Text="SebastianD", Colour=cmyk)
tag_28 = TextTag(Location=pt_simon, Text="Simon", Colour=cmyk)
tag_29 = TextTag(Location=pt_iva, Text="Iva", Colour=cmyk)
tag_30 = TextTag(Location=pt_annette, Text="Annette", Colour=cmyk)
tag_31 = TextTag(Location=pt_yimin, Text="Yimin", Colour=cmyk)
tag_32 = TextTag(Location=pt_arndt, Text="Arndt", Colour=cmyk)
tag_33 = TextTag(Location=pt_felix, Text="Felix", Colour=cmyk)
tag_34 = TextTag(Location=pt_maissa, Text="Maissa", Colour=cmyk)
tag_35 = TextTag(Location=pt_marlene, Text="Marlene", Colour=cmyk)
tag_36 = TextTag(Location=pt_iker, Text="Iker", Colour=cmyk)
tag_37 = TextTag(Location=pt_tamas, Text="Tamas", Colour=cmyk)
tag_38 = TextTag(Location=pt_jörg, Text="Jörg", Colour=cmyk)
tag_39 = TextTag(Location=pt_ariadna, Text="Ariadna", Colour=cmyk)
tag_40 = TextTag(Location=pt_shrestha, Text="Shrestha", Colour=cmyk)
tag_41 = TextTag(Location=pt_pauline, Text="Pauline", Colour=cmyk)
tag_42 = TextTag(Location=pt_clemens, Text="Clemens", Colour=cmyk)
tag_43 = TextTag(Location=pt_ernesto, Text="Ernesto", Colour=cmyk)
tag_44 = TextTag(Location=pt_aryan, Text="Aryan", Colour=cmyk)
ln = Line(StartPoint=pt_julia, EndPoint=[pt_iker, pt_maissa, pt_marlene])
tag_45 = TextTag(Location=pt_lisa, Text="Lisa", Colour=cmyk)
tag_46 = TextTag(Location=pt_parijat, Text="Parijat", Colour=cmyk)
tag_47 = TextTag(Location=pt_martin, Text="Martin", Colour=cmyk)
tag_48 = TextTag(Location=pt_samir, Text="Samir", Colour=cmyk)
ln_2 = Line(
    StartPoint=pt_andre,
    EndPoint=[pt_simon, pt_ernesto, pt_iva, pt_clemens, pt_parijat, pt_lisa, pt_tamas, pt_shrestha, pt_yimin, pt_ariadna, pt_samir])
tag_49 = TextTag(Location=pt_stefanthurner, Text="Stefan Thurner", Colour=cmyk)
ln_3 = Line(StartPoint=pt_enes, EndPoint=pt_inchi)
ln_4 = Line(StartPoint=pt_celine, EndPoint=[pt_zuzanna, pt_toastee])
ln_5 = Line(StartPoint=pt_chris, EndPoint=pt_paulina)
ln_6 = Line(StartPoint=pt_barbara, EndPoint=[pt_alexander, pt_joelf])
ln_7 = Line(StartPoint=pt_daniel, EndPoint=pt_emma)
tag_50 = TextTag(Location=pt_alexander, Text="Alexander", Colour=cmyk)
tag_51 = TextTag(Location=pt_joelf, Text="JoelFischer", Colour=cmyk)
ln_8 = Line(StartPoint=pt_iker, EndPoint=pt_pauline)
ln_9 = Line(StartPoint=pt_peter, EndPoint=[pt_netpartners, pt_partnerorga, pt_spinoffs])
ln_10 = Line(StartPoint=[pt_varun, pt_sebastiand], EndPoint=pt_jörg)
ln_11 = Line(StartPoint=pt_annette, EndPoint=pt_andreas)
ln_12 = Line(StartPoint=pt_arndt, EndPoint=pt_enes)  # -> flatten(Line)
tag_52 = TextTag(Location=pt_andre, Text="André", Colour=cmyk)
ln_13 = Line(StartPoint=pt_jörg, EndPoint=[pt_netpartners, pt_partnerorga, pt_spinoffs])
ln_14 = Line(StartPoint=pt_jörg, EndPoint=pt_simon)  # -> flatten(Line)

panel_2 = Panel("""Chloe 
JoelH
Enes
Felix
Peter
Arndt""")
pt_quantmed = Point(<point referenced from the Rhino model>)
ln_jörg = Line(StartPoint=pt_jörg, EndPoint=pt_quantmed)  # -> flatten(Line)
ln_all = Line(StartPoint=pt_quantmed, EndPoint=[pt_chloé, pt_enes, pt_joelh, pt_arndt, pt_felix])

panel_3 = Panel("""Chris
Philipp
Spirchman
Martin
Andreas""")
pt_vr_tech = Point(<point referenced from the Rhino model>)
ln_jörg_2 = Line(StartPoint=pt_jörg, EndPoint=pt_vr_tech)  # -> flatten(Line)
ln_all_2 = Line(StartPoint=pt_vr_tech, EndPoint=[pt_martin, pt_philipp, pt_spirchman, pt_chris, pt_andreas])

panel_4 = Panel("""Chloe
Iker
Michel
Cristian
Daniel
Maissa
Enes
Aryan
Joel
Julia
Mathilde""")
pt_transmed = Point(<point referenced from the Rhino model>)
ln_jörg_3 = Line(StartPoint=pt_jörg, EndPoint=pt_transmed)  # -> flatten(Line)
ln_all_3 = Line(
    StartPoint=pt_transmed,
    EndPoint=[pt_chloé, pt_cristian, pt_michel, pt_daniel, pt_maissa, pt_iker, pt_enes, pt_aryan, pt_joelh, pt_mathilde])

panel_5 = Panel("""Chloe
Cristian
Celine
JoelH
Aryan
Ines
Marlene
Daniel
Zuzanna""")
pt_i2o = Point(<point referenced from the Rhino model>)
ln_all_4 = Line(
    StartPoint=pt_i2o,
    EndPoint=[pt_celine, pt_chloé, pt_cristian, pt_daniel, pt_ines, pt_aryan, pt_joelh, pt_zuzanna, pt_marlene])
ln_jörg_4 = Line(StartPoint=pt_jörg, EndPoint=pt_i2o)  # -> flatten(Line)

pt = Point(<point referenced from the Rhino model>)
ln_15 = Line(StartPoint=pt, EndPoint=[pt_andreas, pt_sab, pt_barbara, pt_jörg, pt_julia, pt_andre, pt_stefanthurner])

ln_16 = Line(StartPoint=pt_julia, EndPoint=pt_andre)
ln_17 = Line(StartPoint=pt_stefanthurner, EndPoint=pt_andre)
ln_18 = Line(StartPoint=pt_andreas, EndPoint=pt_sab)
ln_19 = Line(StartPoint=pt_sab, EndPoint=pt_barbara)
ln_20 = Line(StartPoint=pt_stefanthurner, EndPoint=pt_andreas)
ln_21 = Line(StartPoint=pt_barbara, EndPoint=pt_julia)

tag_53 = TextTag(Location=pt_transmed, Text="TranslationalMed", Colour=cmyk)
tag_54 = TextTag(Location=pt_i2o, Text="Interactome2.0", Colour=cmyk)
tag_55 = TextTag(Location=pt_quantmed, Text="Quantum", Colour=cmyk)
tag_56 = TextTag(Location=pt_vr_tech, Text="VR+Tech", Colour=cmyk)

pt_2 = Point(<point referenced from the Rhino model>)
ln_22 = Line(StartPoint=pt_jörg, EndPoint=pt_2)
line = Line(ln_22)

line_2 = Line(flatten([ln_6, ln, ln_8, ln_13, ln_14, ln_12, ln_all, ln_all_2, ln_jörg_2, ln_jörg, ln_all_4, ln_jörg_4, ln_all_3, ln_jörg_3, ln_9, ln_4, ln_5, ln_7, ln_3, ln_2, ln_10, ln_11, ln_22]))
line_3 = Line([ln_15, ln_20, ln_18, ln_19, ln_21, ln_16, ln_17])

panel_6 = Panel(line_3)
panel_7 = Panel(line_2)

# ----
# DEPTH of cut into Nodes / for Link mounting
number_slider = Slider(20, range=0..40)

# ----
# DEPTH of cut into Nodes / for Link mounting
number_slider_2 = Slider(24, range=0..40)

# ----
# DEPTH of cut into Nodes / for Link mounting
number_slider_3 = Slider(14, range=0..40)

number_slider_4 = Slider(53, range=0..140)
line_4 = Line([Line((12304.79597, -1346.922504, 726.0968783), (12619.40355, -1032.999997, 727.7020225)), Line((12304.79597, -1346.922504, 726.0968783), (12304.79637, -1032.999997, 1042.309691)), Line((12304.79597, -1346.922504, 726.0968783), (11990.18851, -1347.607665, 1042.309691)), Line((12304.79597, -1346.922504, 726.0968783), (11990.18851, -1662.215333, 727.7020225)), Line((12304.79597, -1346.922504, 726.0968783), (12304.79637, -1662.215333, 413.0943543)), Line((12304.79597, -1346.922504, 726.0968783), (12619.40355, -1347.607665, 413.0943543))])

# ----
# DEPTH of cut into Nodes / for Link mounting
number_slider_5 = Slider(11, range=0..40)

divide = DivideCurve(Curve=line, Count=number_slider_4, Kinks=False)  # -> Points, Tangents, Parameters
subtraction = Subtraction(A=number_slider_4, B=Slider(1, range=0..1))

# ----
# DEPTH of cut into Nodes / for Link mounting
number_slider_6 = Slider(7, range=0..40)

dupln = RemoveDuplicateLines(Lines=flatten(line_4), Tolerance=0.01)

dupln_2 = RemoveDuplicateLines(Lines=flatten(line_2), Tolerance=0.01)
len = Length(Curve=dupln_2)
division = Division(A=len, B=number_slider_6)
divide_2 = DivideCurve(Curve=dupln_2, Count=division, Kinks=False)  # -> Points, Tangents, Parameters
lng = ListLength(List=divide_2.Points)
number_slider_7 = Slider(1, range=0..10)
subtraction_2 = Subtraction(A=lng, B=Slider(2, range=0..10))
subtraction_3 = Subtraction(A=subtraction_2, B=Slider(7, range=0..10))
addition = Addition(A=number_slider_7, B=Slider(8, range=0..10))
item = ListItem(List=divide_2.Points, Index=subtraction_2, Wrap=True)
item_2 = ListItem(List=divide_2.Points, Index=subtraction_3, Wrap=True)
item_3 = ListItem(List=divide_2.Points, Index=addition, Wrap=True)
item_4 = ListItem(List=divide_2.Points, Index=number_slider_7, Wrap=True)
ln_23 = Line(StartPoint=item_2, EndPoint=item)
ln_24 = Line(StartPoint=item_3, EndPoint=item_4)
diameter = Slider(16, range=0..100)
number_slider_8 = Slider(1, range=0..10)
division_2 = Division(A=diameter, B=Slider(2, range=0..10))
pipe = Pipe(Curve=[ln_23, ln_24], Radius=division_2, Caps=number_slider_8)

len_2 = Length(Curve=dupln)
division_3 = Division(A=len_2, B=number_slider_5)
divide_3 = DivideCurve(Curve=dupln, Count=division_3, Kinks=False)  # -> Points, Tangents, Parameters
item_5 = ListItem(List=divide.Points, Index=subtraction, Wrap=True)
number_slider_9 = Slider(0, range=0..10)
addition_2 = Addition(A=number_slider_9, B=Slider(3.25, range=0..10))
item_6 = ListItem(List=divide_3.Points, Index=addition_2, Wrap=True)
item_7 = ListItem(List=divide_3.Points, Index=number_slider_9, Wrap=True)
diameter_2 = Slider(20, range=0..100)
ln_25 = Line(StartPoint=[item_6, item_5], EndPoint=item_7)
item_8 = ListItem(List=flatten(ln_25), Index=0, Wrap=True)

number_slider_10 = Slider(133, range=0..300)
divide_4 = DivideCurve(Curve=flatten(line_2), Count=number_slider_10, Kinks=False)  # -> Points, Tangents, Parameters
panel_8 = Panel("LINKS as pipes ")
number_slider_11 = Slider(2, range=0..2)
subtraction_4 = Subtraction(A=number_slider_10, B=number_slider_11)
item_9 = ListItem(List=divide_4.Points, Index=number_slider_11, Wrap=True)  # -> flatten(Item)
item_10 = ListItem(List=divide_4.Points, Index=subtraction_4, Wrap=True)  # -> flatten(Item)
ln_26 = Line(StartPoint=item_9, EndPoint=item_10)
dupln_3 = RemoveDuplicateLines(Lines=ln_26, Tolerance=0.01)
pipe_2 = Pipe(Curve=dupln_3, Radius=division_2, Caps=number_slider_8)

division_4 = Division(A=Slider(16, range=0..100), B=Slider(2, range=0..10))
number_slider_12 = Slider(1, range=0..10)
division_5 = Division(A=diameter_2, B=Slider(2, range=0..10))
pipe_3 = Pipe(Curve=item_8, Radius=division_4, Caps=number_slider_12)
division_6 = Division(A=Slider(16.25, range=0..100), B=Slider(2, range=0..10))
pipe_4 = Pipe(Curve=line_4, Radius=division_6, Caps=number_slider_12)
pipe_5 = Pipe(Curve=ln_25, Radius=division_5, Caps=number_slider_12)
sdiff = SolidDifference(BrepsA=flatten(pipe_5), BrepsB=flatten([pipe_4, pipe_3]))

panel_9 = Panel("PIPES")
mesh = Mesh(pipe_2)

panel_10 = Panel("Center Connector")
mesh_2 = Mesh(sdiff)

# ----
# LINE LENGTHS in mm
line_5 = Line(dupln_3)
dupln_4 = RemoveDuplicateLines(Lines=line_5, Tolerance=0.01)
len_3 = Length(Curve=dupln_4)
round = Round(Number=len_3)  # -> Nearest, Floor, Ceiling
larger = LargerThan(FirstNumber=round.Ceiling, SecondNumber=Slider(0, range=0..100))  # -> LargerThan, OrEqualTo
cull = CullPattern(List=round.Ceiling, CullPattern=larger.LargerThan)
bnd = Bounds(Numbers=cull)
panel_11 = Panel(cull)
ma = MassAddition(Input=panel_11)  # -> Result, PartialResults

# ----
# Total length of material in mm
panel_12 = Panel(ma.Result)

# ----
# Bounds i.e. min / max lengths
panel_13 = Panel(bnd)

end = EndPoints(Curve=line_2)  # -> Start, End; disabled
panel_14 = Panel(end.End)  # disabled
panel_15 = Panel(end.Start)  # disabled
panel_16 = Panel("sx,sy,sz,tx,ty,tz")  # disabled
concat = Concatenate(FragmentA=panel_15, FragmentB=panel_14)  # -> flatten(Result); disabled
csv = CreateCSV(DataGridHeaders=panel_16, ValueTree=concat, Delimiter=["{}{}", ","])  # disabled
rep = ReplaceText(Text=csv, Find="}{", Replace=", ", RecursiveReplace=False)  # -> flatten(Result); disabled
rep_2 = ReplaceText(Text=rep, Find="{", Replace=" ", RecursiveReplace=False)  # disabled
rep_3 = ReplaceText(Text=rep_2, Find="}", Replace=" ", RecursiveReplace=False)  # disabled
panel_17 = Panel(rep_3)  # disabled

partnerorga_set_lines = Line(Line((11364.18343, -1346.237362, 413.0943582), (11364.18343, -1032.99999, 726.3317298)))
dupln_5 = RemoveDuplicateLines(Lines=flatten(partnerorga_set_lines), Tolerance=0.01)
len_4 = Length(Curve=dupln_5)
division_7 = Division(A=len_4, B=Slider(6, range=0..40))
divide_5 = DivideCurve(Curve=dupln_5, Count=division_7, Kinks=False)  # -> Points, Tangents, Parameters
number_slider_13 = Slider(0, range=0..10)
addition_3 = Addition(A=number_slider_13, B=Slider(3.25, range=0..10))
item_11 = ListItem(List=divide_5.Points, Index=addition_3, Wrap=True)
item_12 = ListItem(List=divide_5.Points, Index=number_slider_13, Wrap=True)
ln_27 = Line(StartPoint=item_11, EndPoint=item_12)
line_6 = Line(ln_27)
diameter_3 = Slider(20, range=0..100)
number_slider_14 = Slider(1, range=0..10)
division_8 = Division(A=diameter_3, B=Slider(2, range=0..10))
division_9 = Division(A=Slider(16.15, range=0..100), B=Slider(2, range=0..10))
pipe_6 = Pipe(Curve=partnerorga_set_lines, Radius=division_9, Caps=number_slider_14)
pipe_7 = Pipe(Curve=line_6, Radius=division_8, Caps=number_slider_14)
sdiff_2 = SolidDifference(BrepsA=flatten(pipe_7), BrepsB=flatten(pipe_6))

netpartners_set_lines = Line(Line((11364.18343, -719.7626184, 413.0943582), (11364.18343, -1032.99999, 726.3317298)))
dupln_6 = RemoveDuplicateLines(Lines=flatten(netpartners_set_lines), Tolerance=0.01)
len_5 = Length(Curve=dupln_6)
division_10 = Division(A=len_5, B=Slider(6, range=0..40))
divide_6 = DivideCurve(Curve=dupln_6, Count=division_10, Kinks=False)  # -> Points, Tangents, Parameters
number_slider_15 = Slider(0, range=0..10)
addition_4 = Addition(A=number_slider_15, B=Slider(3.25, range=0..10))
item_13 = ListItem(List=divide_6.Points, Index=addition_4, Wrap=True)
item_14 = ListItem(List=divide_6.Points, Index=number_slider_15, Wrap=True)
ln_28 = Line(StartPoint=item_13, EndPoint=item_14)
line_7 = Line(ln_28)
diameter_4 = Slider(20, range=0..100)
number_slider_16 = Slider(1, range=0..10)
division_11 = Division(A=diameter_4, B=Slider(2, range=0..10))
division_12 = Division(A=Slider(16.15, range=0..100), B=Slider(2, range=0..10))
pipe_8 = Pipe(Curve=netpartners_set_lines, Radius=division_12, Caps=number_slider_16)
pipe_9 = Pipe(Curve=line_7, Radius=division_11, Caps=number_slider_16)
sdiff_3 = SolidDifference(BrepsA=flatten(pipe_9), BrepsB=flatten(pipe_8))

flip = FlipCurve(Curve=ln_jörg_4)  # -> Curve, Flag
i2o_lines = Line([ln_all_4, flip.Curve])
panel_18 = Panel("""0
3
4
7
8
9""")
panel_19 = Panel("""1
2
5
6""")
item_15 = ListItem(List=i2o_lines, Index=Slider(4, range=0..10), Wrap=True)
cull_i = CullIndex(List=i2o_lines, Indices=panel_18, Wrap=True)
cull_i_2 = CullIndex(List=i2o_lines, Indices=panel_19, Wrap=True)
dupln_7 = RemoveDuplicateLines(Lines=flatten(cull_i), Tolerance=0.01)
dupln_8 = RemoveDuplicateLines(Lines=flatten(cull_i_2), Tolerance=0.01)
len_6 = Length(Curve=dupln_7)
len_7 = Length(Curve=dupln_8)
division_13 = Division(A=len_6, B=Slider(20, range=0..40))
division_14 = Division(A=len_7, B=Slider(14, range=0..40))
divide_7 = DivideCurve(Curve=dupln_7, Count=division_13, Kinks=False)  # -> Points, Tangents, Parameters
divide_8 = DivideCurve(Curve=dupln_8, Count=division_14, Kinks=False)  # -> Points, Tangents, Parameters
number_slider_17 = Slider(0, range=0..10)
number_slider_18 = Slider(0, range=0..10)
addition_5 = Addition(A=number_slider_17, B=Slider(3.25, range=0..10))
addition_6 = Addition(A=number_slider_18, B=Slider(3.25, range=0..10))
item_16 = ListItem(List=divide_7.Points, Index=addition_5, Wrap=True)
item_17 = ListItem(List=divide_7.Points, Index=number_slider_17, Wrap=True)
item_18 = ListItem(List=divide_8.Points, Index=addition_6, Wrap=True)
item_19 = ListItem(List=divide_8.Points, Index=number_slider_18, Wrap=True)
diameter_5 = Slider(20, range=0..100)
ln_29 = Line(StartPoint=item_16, EndPoint=item_17)
ln_30 = Line(StartPoint=item_18, EndPoint=item_19)
number_slider_19 = Slider(1, range=0..10)
division_15 = Division(A=diameter_5, B=Slider(2, range=0..10))
line_8 = Line([ln_30, ln_29])
division_16 = Division(A=Slider(16.15, range=0..100), B=Slider(2, range=0..10))
pipe_10 = Pipe(Curve=i2o_lines, Radius=division_16, Caps=number_slider_19)
pipe_11 = Pipe(Curve=line_8, Radius=division_15, Caps=number_slider_19)
sdiff_4 = SolidDifference(BrepsA=flatten(pipe_11), BrepsB=flatten(pipe_10))

spinoffs_set_lines = Line(Line((11676.95099, -1032.99999, 1039.099456), (11364.18343, -1032.99999, 726.3317298)))
dupln_9 = RemoveDuplicateLines(Lines=flatten(spinoffs_set_lines), Tolerance=0.01)
len_8 = Length(Curve=dupln_9)
division_17 = Division(A=len_8, B=Slider(6, range=0..40))
divide_9 = DivideCurve(Curve=dupln_9, Count=division_17, Kinks=False)  # -> Points, Tangents, Parameters
number_slider_20 = Slider(0, range=0..10)
addition_7 = Addition(A=number_slider_20, B=Slider(3.25, range=0..10))
item_20 = ListItem(List=divide_9.Points, Index=addition_7, Wrap=True)
item_21 = ListItem(List=divide_9.Points, Index=number_slider_20, Wrap=True)
ln_31 = Line(StartPoint=item_20, EndPoint=item_21)
line_9 = Line(ln_31)
diameter_6 = Slider(20, range=0..100)
number_slider_21 = Slider(1, range=0..10)
division_18 = Division(A=diameter_6, B=Slider(2, range=0..10))
division_19 = Division(A=Slider(16.15, range=0..100), B=Slider(2, range=0..10))
pipe_12 = Pipe(Curve=spinoffs_set_lines, Radius=division_19, Caps=number_slider_21)
pipe_13 = Pipe(Curve=line_9, Radius=division_18, Caps=number_slider_21)
sdiff_5 = SolidDifference(BrepsA=flatten(pipe_13), BrepsB=flatten(pipe_12))

enes_set_lines = Line([Line((12031.93058, -947.9878845, 114.5747282), (12031.93058, -1111.533152, 171.5774149)), Line((12031.93058, -947.9878845, 114.5747282), (11850.85642, -1032.99999, -56.52687643)), Line((12031.93058, -947.9878845, 114.5747282), (11364.18343, -1032.99999, 99.85698658)), Line((12031.93058, -947.9878845, 114.5747282), (12616.19323, -719.7626184, 413.0943582))])
dupln_10 = RemoveDuplicateLines(Lines=flatten(enes_set_lines), Tolerance=0.01)
len_9 = Length(Curve=dupln_10)
division_20 = Division(A=len_9, B=Slider(9, range=0..40))
divide_10 = DivideCurve(Curve=dupln_10, Count=division_20, Kinks=False)  # -> Points, Tangents, Parameters
number_slider_22 = Slider(0, range=0..10)
addition_8 = Addition(A=number_slider_22, B=Slider(3.25, range=0..10))
item_22 = ListItem(List=divide_10.Points, Index=addition_8, Wrap=True)
item_23 = ListItem(List=divide_10.Points, Index=number_slider_22, Wrap=True)
ln_32 = Line(StartPoint=item_22, EndPoint=item_23)
line_10 = Line(ln_32)
diameter_7 = Slider(20, range=0..100)
number_slider_23 = Slider(1, range=0..10)
division_21 = Division(A=diameter_7, B=Slider(2, range=0..10))
division_22 = Division(A=Slider(16.15, range=0..100), B=Slider(2, range=0..10))
pipe_14 = Pipe(Curve=enes_set_lines, Radius=division_22, Caps=number_slider_23)
pipe_15 = Pipe(Curve=line_10, Radius=division_21, Caps=number_slider_23)
sdiff_6 = SolidDifference(BrepsA=flatten(pipe_15), BrepsB=flatten(pipe_14))

celine_set_lines = Line([Line((11598.87641, -641.6880983, 256.4756724), (11716.22291, -524.3414953, 256.4756724)), Line((11598.87641, -641.6880983, 256.4756724), (11676.95099, -406.9948924, 413.0943582)), Line((11598.87641, -641.6880983, 256.4756724), (11677.18588, -719.9974412, 99.85698658))])
dupln_11 = RemoveDuplicateLines(Lines=flatten(celine_set_lines), Tolerance=0.01)
len_10 = Length(Curve=dupln_11)
division_23 = Division(A=len_10, B=Slider(11, range=0..40))
divide_11 = DivideCurve(Curve=dupln_11, Count=division_23, Kinks=False)  # -> Points, Tangents, Parameters
number_slider_24 = Slider(0, range=0..10)
addition_9 = Addition(A=number_slider_24, B=Slider(3.25, range=0..10))
item_24 = ListItem(List=divide_11.Points, Index=addition_9, Wrap=True)
item_25 = ListItem(List=divide_11.Points, Index=number_slider_24, Wrap=True)
ln_33 = Line(StartPoint=item_24, EndPoint=item_25)
line_11 = Line(ln_33)
diameter_8 = Slider(20, range=0..100)
number_slider_25 = Slider(1, range=0..10)
division_24 = Division(A=diameter_8, B=Slider(2, range=0..10))
division_25 = Division(A=Slider(16.15, range=0..100), B=Slider(2, range=0..10))
pipe_16 = Pipe(Curve=celine_set_lines, Radius=division_25, Caps=number_slider_25)
pipe_17 = Pipe(Curve=line_11, Radius=division_24, Caps=number_slider_25)
sdiff_7 = SolidDifference(BrepsA=flatten(pipe_17), BrepsB=flatten(pipe_16))

joelh_set_lines = Line([Line((11995.51558, -689.9253953, 328.7817302), (12616.19323, -719.7626184, 413.0943582)), Line((11995.51558, -689.9253953, 328.7817302), (11676.95099, -406.9948924, 413.0943582)), Line((11995.51558, -689.9253953, 328.7817302), (11364.18343, -1032.99999, 99.85698658))])
dupln_12 = RemoveDuplicateLines(Lines=flatten(joelh_set_lines), Tolerance=0.01)
len_11 = Length(Curve=dupln_12)
division_26 = Division(A=len_11, B=Slider(6, range=0..40))
divide_12 = DivideCurve(Curve=dupln_12, Count=division_26, Kinks=False)  # -> Points, Tangents, Parameters
number_slider_26 = Slider(0, range=0..10)
addition_10 = Addition(A=number_slider_26, B=Slider(3.25, range=0..10))
item_26 = ListItem(List=divide_12.Points, Index=addition_10, Wrap=True)
item_27 = ListItem(List=divide_12.Points, Index=number_slider_26, Wrap=True)
ln_34 = Line(StartPoint=item_26, EndPoint=item_27)
line_12 = Line(ln_34)
diameter_9 = Slider(20, range=0..100)
number_slider_27 = Slider(1, range=0..10)
division_27 = Division(A=diameter_9, B=Slider(2, range=0..10))
division_28 = Division(A=Slider(16.15, range=0..100), B=Slider(2, range=0..10))
pipe_18 = Pipe(Curve=joelh_set_lines, Radius=division_28, Caps=number_slider_27)
pipe_19 = Pipe(Curve=line_12, Radius=division_27, Caps=number_slider_27)
sdiff_8 = SolidDifference(BrepsA=flatten(pipe_19), BrepsB=flatten(pipe_18))

chloe_set_lines = Line([Line((12031.93058, -773.25424, 142.2764035), (12616.19323, -719.7626184, 413.0943582)), Line((12031.93058, -773.25424, 142.2764035), (11676.95099, -406.9948924, 413.0943582)), Line((12031.93058, -773.25424, 142.2764035), (11364.18343, -1032.99999, 99.85698658))])
dupln_13 = RemoveDuplicateLines(Lines=flatten(chloe_set_lines), Tolerance=0.01)
len_12 = Length(Curve=dupln_13)
division_29 = Division(A=len_12, B=Slider(6, range=0..40))
divide_13 = DivideCurve(Curve=dupln_13, Count=division_29, Kinks=False)  # -> Points, Tangents, Parameters
number_slider_28 = Slider(0, range=0..10)
addition_11 = Addition(A=number_slider_28, B=Slider(3.25, range=0..10))
item_28 = ListItem(List=divide_13.Points, Index=addition_11, Wrap=True)
item_29 = ListItem(List=divide_13.Points, Index=number_slider_28, Wrap=True)
ln_35 = Line(StartPoint=item_28, EndPoint=item_29)
line_13 = Line(ln_35)
diameter_10 = Slider(20, range=0..100)
number_slider_29 = Slider(1, range=0..10)
division_30 = Division(A=diameter_10, B=Slider(2, range=0..10))
division_31 = Division(A=Slider(16.15, range=0..100), B=Slider(2, range=0..10))
pipe_20 = Pipe(Curve=chloe_set_lines, Radius=division_31, Caps=number_slider_29)
pipe_21 = Pipe(Curve=line_13, Radius=division_30, Caps=number_slider_29)
sdiff_9 = SolidDifference(BrepsA=flatten(pipe_21), BrepsB=flatten(pipe_20))

iker_set_lines = Line([Line((12616.19323, -876.3813042, 569.713044), (12619.40355, -1032.999997, 727.7020225)), Line((12616.19323, -876.3813042, 569.713044), (12616.19323, -719.7626184, 413.0943582)), Line((12616.19323, -876.3813042, 569.713044), (12406.77891, -898.7534095, 517.1087656)), Line((12616.19323, -876.3813042, 569.713044), (12616.19323, -719.7626184, 413.0943582))])
dupln_14 = RemoveDuplicateLines(Lines=flatten(iker_set_lines), Tolerance=0.01)
len_13 = Length(Curve=dupln_14)
division_32 = Division(A=len_13, B=Slider(6, range=0..40))
divide_14 = DivideCurve(Curve=dupln_14, Count=division_32, Kinks=False)  # -> Points, Tangents, Parameters
number_slider_30 = Slider(0, range=0..10)
addition_12 = Addition(A=number_slider_30, B=Slider(3.25, range=0..10))
item_30 = ListItem(List=divide_14.Points, Index=addition_12, Wrap=True)
item_31 = ListItem(List=divide_14.Points, Index=number_slider_30, Wrap=True)
ln_36 = Line(StartPoint=item_30, EndPoint=item_31)
line_14 = Line(ln_36)
diameter_11 = Slider(20, range=0..100)
number_slider_31 = Slider(1, range=0..10)
division_33 = Division(A=diameter_11, B=Slider(2, range=0..10))
division_34 = Division(A=Slider(16.15, range=0..100), B=Slider(2, range=0..10))
pipe_22 = Pipe(Curve=iker_set_lines, Radius=division_34, Caps=number_slider_31)
pipe_23 = Pipe(Curve=line_14, Radius=division_33, Caps=number_slider_31)
sdiff_10 = SolidDifference(BrepsA=flatten(pipe_23), BrepsB=flatten(pipe_22))

# ----
# additional node-parts to fix many edge overlaps
andre_lines_2 = Line(ln_2)
andre_lines = Line(flatten(andre_lines_2))
dupln_15 = RemoveDuplicateLines(Lines=flatten(andre_lines), Tolerance=0.01)
len_14 = Length(Curve=dupln_15)
division_35 = Division(A=len_14, B=number_slider)
divide_15 = DivideCurve(Curve=dupln_15, Count=division_35, Kinks=False)  # -> Points, Tangents, Parameters
number_slider_32 = Slider(0, range=0..10)
addition_13 = Addition(A=number_slider_32, B=Slider(3.25, range=0..10))
item_32 = ListItem(List=divide_15.Points, Index=addition_13, Wrap=True)
item_33 = ListItem(List=divide_15.Points, Index=number_slider_32, Wrap=True)
ln_37 = Line(StartPoint=item_32, EndPoint=item_33)
diameter_12 = Slider(20, range=0..100)
number_slider_33 = Slider(1, range=0..10)
division_36 = Division(A=diameter_12, B=Slider(2, range=0..10))
division_37 = Division(A=Slider(16.15, range=0..100), B=Slider(2, range=0..10))
pipe_24 = Pipe(Curve=andre_lines, Radius=division_37, Caps=number_slider_33)
pipe_25 = Pipe(Curve=ln_37, Radius=division_36, Caps=number_slider_33)
sdiff_11 = SolidDifference(BrepsA=flatten(pipe_25), BrepsB=flatten(pipe_24))

julia_set_lines = Line([Line((12619.40355, -1032.999997, 727.7020225), (11990.18833, -406.9948924, 726.3317298)), Line((12619.40355, -1032.999997, 727.7020225), (12304.79597, -1346.922504, 726.0968783)), Line((12619.40355, -1032.999997, 727.7020225), (12619.40355, -1347.607665, 413.0943543)), Line((12619.40355, -1032.999997, 727.7020225), (12304.79637, -1032.999997, 1042.309691)), Line((12619.40355, -1032.999997, 727.7020225), (12514.97557, -830.566995, 633.6423119)), Line((12619.40355, -1032.999997, 727.7020225), (12616.19323, -876.3813042, 569.713044))])
dupln_16 = RemoveDuplicateLines(Lines=flatten(julia_set_lines), Tolerance=0.01)
len_15 = Length(Curve=dupln_16)
division_38 = Division(A=len_15, B=Slider(14, range=0..40))
divide_16 = DivideCurve(Curve=dupln_16, Count=division_38, Kinks=False)  # -> Points, Tangents, Parameters
number_slider_34 = Slider(0, range=0..10)
addition_14 = Addition(A=number_slider_34, B=Slider(3.25, range=0..10))
item_34 = ListItem(List=divide_16.Points, Index=addition_14, Wrap=True)
item_35 = ListItem(List=divide_16.Points, Index=number_slider_34, Wrap=True)
ln_38 = Line(StartPoint=item_34, EndPoint=item_35)
line_15 = Line(ln_38)
diameter_13 = Slider(20, range=0..100)
number_slider_35 = Slider(1, range=0..10)
division_39 = Division(A=diameter_13, B=Slider(2, range=0..10))
division_40 = Division(A=Slider(16.15, range=0..100), B=Slider(2, range=0..10))
pipe_26 = Pipe(Curve=julia_set_lines, Radius=division_40, Caps=number_slider_35)
pipe_27 = Pipe(Curve=line_15, Radius=division_39, Caps=number_slider_35)
sdiff_12 = SolidDifference(BrepsA=flatten(pipe_27), BrepsB=flatten(pipe_26))

flip_2 = FlipCurve(Curve=ln_jörg)  # -> Curve, Flag
quantum_lines = Line([ln_all, flip_2.Curve])
panel_20 = Panel("""2
3
5
6""")
panel_21 = Panel("""2
3
4""")
cull_i_3 = CullIndex(List=quantum_lines, Indices=Slider(4, range=0..100), Wrap=True)
item_36 = ListItem(List=cull_i_3, Index=Slider(3, range=0..10), Wrap=True)
cull_i_4 = CullIndex(List=cull_i_3, Indices=panel_21, Wrap=True)
cull_i_5 = CullIndex(List=cull_i_3, Indices=panel_20, Wrap=True)
cull_i_6 = CullIndex(List=cull_i_3, Indices="4", Wrap=True)
dupln_17 = RemoveDuplicateLines(Lines=flatten(cull_i_5), Tolerance=0.01)
dupln_18 = RemoveDuplicateLines(Lines=flatten(cull_i_4), Tolerance=0.01)
dupln_19 = RemoveDuplicateLines(Lines=flatten(cull_i_6), Tolerance=0.01)
len_16 = Length(Curve=dupln_17)
len_17 = Length(Curve=dupln_18)
len_18 = Length(Curve=dupln_19)
division_41 = Division(A=len_16, B=Slider(14, range=0..40))
division_42 = Division(A=len_17, B=Slider(26, range=0..40))
division_43 = Division(A=len_18, B=Slider(22, range=0..40))
divide_17 = DivideCurve(Curve=dupln_17, Count=division_41, Kinks=False)  # -> Points, Tangents, Parameters
number_slider_36 = Slider(0, range=0..10)
divide_18 = DivideCurve(Curve=dupln_18, Count=division_42, Kinks=False)  # -> Points, Tangents, Parameters
divide_19 = DivideCurve(Curve=dupln_19, Count=division_43, Kinks=False)  # -> Points, Tangents, Parameters
number_slider_37 = Slider(0, range=0..10)
number_slider_38 = Slider(0, range=0..10)
addition_15 = Addition(A=number_slider_36, B=Slider(3.25, range=0..10))
addition_16 = Addition(A=number_slider_37, B=Slider(3.25, range=0..10))
addition_17 = Addition(A=number_slider_38, B=Slider(3.25, range=0..10))
item_37 = ListItem(List=divide_17.Points, Index=addition_15, Wrap=True)
item_38 = ListItem(List=divide_17.Points, Index=number_slider_36, Wrap=True)
item_39 = ListItem(List=divide_18.Points, Index=addition_16, Wrap=True)
item_40 = ListItem(List=divide_18.Points, Index=number_slider_37, Wrap=True)
item_41 = ListItem(List=divide_19.Points, Index=addition_17, Wrap=True)
item_42 = ListItem(List=divide_19.Points, Index=number_slider_38, Wrap=True)
diameter_14 = Slider(20, range=0..100)
ln_39 = Line(StartPoint=item_37, EndPoint=item_38)
ln_40 = Line(StartPoint=item_39, EndPoint=item_40)
ln_41 = Line(StartPoint=item_41, EndPoint=item_42)
number_slider_39 = Slider(1, range=0..10)
line_16 = Line([ln_39, ln_40, ln_41])
division_44 = Division(A=diameter_14, B=Slider(2, range=0..10))
division_45 = Division(A=Slider(16.15, range=0..100), B=Slider(2, range=0..10))
pipe_28 = Pipe(Curve=[cull_i_5, cull_i_4, cull_i_6], Radius=division_45, Caps=number_slider_39)
pipe_29 = Pipe(Curve=line_16, Radius=division_44, Caps=number_slider_39)
sdiff_13 = SolidDifference(BrepsA=flatten(pipe_29), BrepsB=flatten(pipe_28))

panel_22 = Panel("""2
3
4
5
9
10""")
panel_23 = Panel("""0
1
6
7
8""")
flip_3 = FlipCurve(Curve=ln_jörg_3)  # -> Curve, Flag
translatmed_lines = Line([ln_all_3, flip_3.Curve])
cull_i_7 = CullIndex(List=translatmed_lines, Indices=panel_22, Wrap=True)
cull_i_8 = CullIndex(List=translatmed_lines, Indices=panel_23, Wrap=True)
dupln_20 = RemoveDuplicateLines(Lines=flatten(cull_i_7), Tolerance=0.01)
dupln_21 = RemoveDuplicateLines(Lines=flatten(cull_i_8), Tolerance=0.01)
len_19 = Length(Curve=dupln_20)
len_20 = Length(Curve=dupln_21)
division_46 = Division(A=len_19, B=number_slider_2)
division_47 = Division(A=len_20, B=number_slider_3)
divide_20 = DivideCurve(Curve=dupln_20, Count=division_46, Kinks=False)  # -> Points, Tangents, Parameters
divide_21 = DivideCurve(Curve=dupln_21, Count=division_47, Kinks=False)  # -> Points, Tangents, Parameters
number_slider_40 = Slider(0, range=0..10)
number_slider_41 = Slider(0, range=0..10)
addition_18 = Addition(A=number_slider_40, B=Slider(3.25, range=0..10))
addition_19 = Addition(A=number_slider_41, B=Slider(3.25, range=0..10))
item_43 = ListItem(List=divide_20.Points, Index=addition_18, Wrap=True)
item_44 = ListItem(List=divide_20.Points, Index=number_slider_40, Wrap=True)
item_45 = ListItem(List=divide_21.Points, Index=addition_19, Wrap=True)
item_46 = ListItem(List=divide_21.Points, Index=number_slider_41, Wrap=True)
diameter_15 = Slider(20, range=0..100)
ln_42 = Line(StartPoint=item_43, EndPoint=item_44)
ln_43 = Line(StartPoint=item_45, EndPoint=item_46)
number_slider_42 = Slider(1, range=0..10)
division_48 = Division(A=diameter_15, B=Slider(2, range=0..10))
line_17 = Line(flatten([ln_42, ln_43]))
division_49 = Division(A=Slider(16.15, range=0..100), B=Slider(2, range=0..10))
pipe_30 = Pipe(Curve=[cull_i_8, cull_i_7], Radius=division_49, Caps=number_slider_42)
pipe_31 = Pipe(Curve=line_17, Radius=division_48, Caps=number_slider_42)
sdiff_14 = SolidDifference(BrepsA=flatten(pipe_31), BrepsB=flatten(pipe_30))

pt_industry = Point([pt_peter, pt_netpartners, pt_partnerorga, pt_spinoffs])
pt_centercenter = Point(pt_jörg)
pt_logonodes = Point([pt_stefanthurner, pt_andreas, pt_sab, pt_barbara, pt_julia, pt_andre])
pt_all_menches = Point([pt_martin, pt_aryan, pt_celine, pt_chloé, pt_cristian, pt_chris, pt_daniel, pt_enes, pt_emma, pt_inchi, pt_ines, pt_joelh, pt_mathilde, pt_michel, pt_paulina, pt_philipp, pt_toastee, pt_spirchman, pt_zuzanna, pt_varun, pt_sebastiand, pt_simon, pt_arndt, pt_annette, pt_felix])
pt_mobs = Point([pt_transmed, pt_i2o, pt_vr_tech, pt_quantmed])
pt_all_rendeiro = Point([pt_ernesto, pt_iva, pt_yimin, pt_ariadna, pt_shrestha, pt_tamas, pt_parijat, pt_samir])
pt_all_geist = Point([pt_alexander, pt_joelf])
pt_all_guthrie = Point([pt_maissa, pt_marlene, pt_iker, pt_pauline])
panel_24 = Panel("NODE SHAPE")
number_slider_43 = Slider(32, range=0..100)
number_slider_44 = Slider(38, range=0..100)
number_slider_45 = Slider(18, range=0..100)
wbicosahedron = WeaverbirdsMeshMeshIcosahedron(Plane=[pt_all_menches, pt_all_geist, pt_all_guthrie, pt_all_rendeiro, pt_industry], Radius=number_slider_45)

pt_3 = Point([pt_centercenter, pt_mobs, pt_logonodes, pt_all_menches, pt_all_geist, pt_all_guthrie, pt_all_rendeiro, pt_industry])
pdecon = Deconstruct(Point=pt_all_menches)  # -> XComponent, YComponent, ZComponent
pdecon_2 = Deconstruct(Point=pt_all_geist)  # -> XComponent, YComponent, ZComponent
pdecon_3 = Deconstruct(Point=pt_all_guthrie)  # -> XComponent, YComponent, ZComponent
pdecon_4 = Deconstruct(Point=pt_industry)  # -> XComponent, YComponent, ZComponent
pdecon_5 = Deconstruct(Point=pt_all_rendeiro)  # -> XComponent, YComponent, ZComponent
pdecon_6 = Deconstruct(Point=pt_mobs)  # -> XComponent, YComponent, ZComponent
pdecon_7 = Deconstruct(Point=pt_3)  # -> XComponent, YComponent, ZComponent
pt_4 = ConstructPoint(XCoordinate=pdecon.XComponent, YCoordinate=pdecon.YComponent, ZCoordinate=pdecon.ZComponent)
pt_5 = ConstructPoint(XCoordinate=pdecon_2.XComponent, YCoordinate=pdecon_2.YComponent, ZCoordinate=pdecon_2.ZComponent)
pt_6 = ConstructPoint(XCoordinate=pdecon_3.XComponent, YCoordinate=pdecon_3.YComponent, ZCoordinate=pdecon_3.ZComponent)
pt_7 = ConstructPoint(XCoordinate=pdecon_4.XComponent, YCoordinate=pdecon_4.YComponent, ZCoordinate=pdecon_4.ZComponent)
pt_8 = ConstructPoint(XCoordinate=pdecon_6.XComponent, YCoordinate=pdecon_6.YComponent, ZCoordinate=pdecon_6.ZComponent)
pt_9 = ConstructPoint(XCoordinate=pdecon_5.XComponent, YCoordinate=pdecon_5.YComponent, ZCoordinate=pdecon_5.ZComponent)
pt_10 = ConstructPoint(XCoordinate=pdecon_7.XComponent, YCoordinate=pdecon_7.YComponent, ZCoordinate=pdecon_7.ZComponent)
panel_25 = Panel(pt_10)
platododec = PlatonicDodecahedron(Plane=[pt_logonodes, pt_mobs], Radius=number_slider_43)
platododec_2 = PlatonicDodecahedron(Plane=pt_centercenter, Radius=number_slider_44)

mesh_3 = Mesh([wbicosahedron, platododec, platododec_2])

concat_2 = Concatenate(FragmentB=",", FragmentC=panel_25)
panel_26 = Panel(concat_2)

# ----
# COMPUTES boolean difference for nodes+holes where links should be placed.
number_slider_46 = Slider(3, range=0..100)
faceb = FaceBoundaries(Mesh=mesh_3)
boundary = BoundarySurfaces(Edges=faceb, UseTasks=False)
join = BrepJoin(Breps=boundary)  # -> Breps, Closed
item_47 = ListItem(List=pipe, Index=number_slider_46, Wrap=True)  # -> flatten(Item)
brep = Brep(join.Breps)
sort = SortList(Keys=item_47, ValuesA=item_47)  # -> Keys, flatten(ValuesA)
item_48 = ListItem(List=brep, Index=0, Wrap=True)  # -> flatten(Item)
sort_2 = SortList(Keys=item_48, ValuesA=item_48)  # -> Keys, flatten(ValuesA)

multiplication = Multiplication(A=number_slider_43, B=Slider(0.6, range=0..1))
multiplication_2 = Multiplication(A=number_slider_44, B=Slider(0.6, range=0..1))
multiplication_3 = Multiplication(A=number_slider_45, B=Slider(0.6, range=0..1))
sph = Sphere(Base=pt_centercenter, Radius=multiplication_2)
sph_2 = Sphere(Base=[pt_mobs, pt_logonodes], Radius=multiplication)
sph_3 = Sphere(Base=[pt_all_menches, pt_all_geist, pt_all_guthrie, pt_all_rendeiro, pt_industry], Radius=multiplication_3)

brep_2 = Brep(sph)
brep_3 = Brep(sph_3)
brep_4 = Brep(sph_2)
brep_all = Brep([brep_3, brep_4, brep_2])

sdiff_15 = SolidDifference(BrepsA=sort_2.ValuesA, BrepsB=sort.ValuesA)
panel_27 = Panel("NODES")

sdiff_16 = SolidDifference(BrepsA=sdiff_15, BrepsB=[brep_3, brep_2, brep_4])

brep_5 = Brep(sph_2)
sdiff_17 = SolidDifference(BrepsA=sdiff_14, BrepsB=brep_5)
item_49 = ListItem(List=sdiff_16, Index=Slider(49, range=0..100), Wrap=True)
mesh_4 = Mesh([item_49, sdiff_17])

brep_6 = Brep(sph_2)
sdiff_18 = SolidDifference(BrepsA=sdiff_11, BrepsB=brep_6)
item_50 = ListItem(List=sdiff_16, Index=Slider(46, range=0..100), Wrap=True)
mesh_5 = Mesh([item_50, sdiff_18])

item_51 = ListItem(List=sdiff_16, Index=Slider(43, range=0..100), Wrap=True)
sdiff_19 = SolidDifference(BrepsA=sdiff_13, BrepsB=brep_all)
mesh_6 = Mesh([item_51, sdiff_19])

sdiff_20 = SolidDifference(BrepsA=sdiff_6, BrepsB=brep_all)
item_52 = ListItem(List=sdiff_16, Index=Slider(25, range=0..100), Wrap=True)
mesh_7 = Mesh([item_52, sdiff_20])

sdiff_21 = SolidDifference(BrepsA=sdiff_8, BrepsB=brep_all)
item_53 = ListItem(List=sdiff_16, Index=Slider(17, range=0..100), Wrap=True)
mesh_8 = Mesh([item_53, sdiff_21])

sdiff_22 = SolidDifference(BrepsA=sdiff_5, BrepsB=brep_all)
item_54 = ListItem(List=sdiff_16, Index=Slider(10, range=0..100), Wrap=True)
mesh_9 = Mesh([item_54, sdiff_22])

sdiff_23 = SolidDifference(BrepsA=sdiff_3, BrepsB=brep_all)
item_55 = ListItem(List=sdiff_16, Index=Slider(38, range=0..100), Wrap=True)
mesh_10 = Mesh([item_55, sdiff_23])

sdiff_24 = SolidDifference(BrepsA=sdiff_2, BrepsB=brep_all)
item_56 = ListItem(List=sdiff_16, Index=Slider(36, range=0..100), Wrap=True)
mesh_11 = Mesh([item_56, sdiff_24])

sdiff_25 = SolidDifference(BrepsA=sdiff_7, BrepsB=brep_all)
item_57 = ListItem(List=sdiff_16, Index=Slider(16, range=0..100), Wrap=True)
mesh_12 = Mesh([item_57, sdiff_25])

sdiff_26 = SolidDifference(BrepsA=sdiff_4, BrepsB=brep_all)
item_58 = ListItem(List=sdiff_16, Index=Slider(44, range=0..100), Wrap=True)
mesh_13 = Mesh([item_58, sdiff_26])

sdiff_27 = SolidDifference(BrepsA=sdiff_9, BrepsB=brep_all)
item_59 = ListItem(List=sdiff_16, Index=Slider(57, range=0..100), Wrap=True)
mesh_14 = Mesh([item_59, sdiff_27])

sdiff_28 = SolidDifference(BrepsA=sdiff_12, BrepsB=brep_all)
item_60 = ListItem(List=sdiff_16, Index=Slider(50, range=0..100), Wrap=True)
mesh_15 = Mesh([item_60, sdiff_28])

item_61 = ListItem(List=sdiff_16, Index=Slider(18, range=0..100), Wrap=True)
sdiff_29 = SolidDifference(BrepsA=sdiff_10, BrepsB=brep_all)
mesh_16 = Mesh([item_61, sdiff_29])

panel_28 = Panel("ANIMATE")  # disabled
number_slider_47 = Slider(200, range=0..200)  # disabled
number_slider_48 = Slider(100, range=0..100)  # disabled
number_slider_49 = Slider(20, range=0..20)  # disabled
# Jörg, TranslatMed
# Jörg, Interactome2O
# Jörg, QuantumMed
# Jörg, VRMob
# Jörg, SebastianD
# Jörg, Simon
# Jörg, Varun
# Jörg, PartnerOrganizsations
# Jörg, NetworkPartners
# Jörg, Spinoffs
# Jörg, Connector
mesh_17 = Mesh([mesh_2, mesh, sort_2.ValuesA])  # disabled
rotate = Rotate(Geometry=mesh_17, Angle=number_slider_47, Plane=pt_volumecenter)  # -> Geometry, Transform; disabled
series = Series(Start=rotate.Geometry, Step=number_slider_49, Count=number_slider_48)  # disabled

panel_29 = Panel(pt_centercenter)

rep_4 = ReplaceText(Text=panel_29, Find="{", Replace=" ", RecursiveReplace=False)
rep_5 = ReplaceText(Text=rep_4, Find="}", Replace=" ", RecursiveReplace=False)

concat_3 = Concatenate(FragmentA="Jörg", FragmentB=",", FragmentC=rep_5)

panel_30 = Panel(concat_3)

panel_31 = Panel("""StefanThurner
Andreas
SAB
Barbara
Julia
Andre""")
panel_32 = Panel(pt_logonodes)

rep_6 = ReplaceText(Text=panel_32, Find="{", Replace=" ", RecursiveReplace=False)
rep_7 = ReplaceText(Text=rep_6, Find="}", Replace=" ", RecursiveReplace=False)

concat_4 = Concatenate(FragmentA=panel_31, FragmentB=",", FragmentC=rep_7)

panel_33 = Panel(concat_4)

panel_34 = Panel("""TranslatMed
Interactome2O
VRMob
QuantumMed""")
panel_35 = Panel(pt_8)

rep_8 = ReplaceText(Text=panel_35, Find="{", Replace=" ", RecursiveReplace=False)
rep_9 = ReplaceText(Text=rep_8, Find="}", Replace=" ", RecursiveReplace=False)

concat_5 = Concatenate(FragmentA=panel_34, FragmentB=",", FragmentC=rep_9)

panel_36 = Panel(concat_5)

panel_37 = Panel("""Martin
Aryan
Celine
Chloe
Cristian
Chris
Daniel
Enes
Emma
Inchi
Ines
JoelH
Mathilde
Michel
Paulina
Philipp
Toastee
Spirchman
Zuzanna
Varun
SebastianD
Simon
Arndt
Annette
Felix""")
panel_38 = Panel(pt_4)

rep_10 = ReplaceText(Text=panel_38, Find="{", Replace=" ", RecursiveReplace=False)
rep_11 = ReplaceText(Text=rep_10, Find="}", Replace=" ", RecursiveReplace=False)

concat_6 = Concatenate(FragmentA=panel_37, FragmentB=",", FragmentC=rep_11)

panel_39 = Panel(concat_6)

panel_40 = Panel("""Peter
PartnerOrganizations
NetworkPartners
Spinoffs""")
panel_41 = Panel(pt_7)

rep_12 = ReplaceText(Text=panel_41, Find="{", Replace=" ", RecursiveReplace=False)
rep_13 = ReplaceText(Text=rep_12, Find="}", Replace=" ", RecursiveReplace=False)

concat_7 = Concatenate(FragmentA=panel_40, FragmentB=",", FragmentC=rep_13)

panel_42 = Panel(concat_7)

panel_43 = Panel("""Alexander
JoelF""")
panel_44 = Panel(pt_5)

rep_14 = ReplaceText(Text=panel_44, Find="{", Replace=" ", RecursiveReplace=False)
rep_15 = ReplaceText(Text=rep_14, Find="}", Replace=" ", RecursiveReplace=False)

concat_8 = Concatenate(FragmentA=panel_43, FragmentB=",", FragmentC=rep_15)

panel_45 = Panel(concat_8)

panel_46 = Panel("""Maissa
Marlene
Iker
Pauline""")
panel_47 = Panel(pt_6)

rep_16 = ReplaceText(Text=panel_47, Find="{", Replace=" ", RecursiveReplace=False)
rep_17 = ReplaceText(Text=rep_16, Find="}", Replace=" ", RecursiveReplace=False)

concat_9 = Concatenate(FragmentA=panel_46, FragmentB=",", FragmentC=rep_17)

panel_48 = Panel(concat_9)

panel_49 = Panel("""Ernesto
Iva
Yimin
Ariadna
Shresta
Tamas
Parijat
Samir""")
panel_50 = Panel(pt_9)

rep_18 = ReplaceText(Text=panel_50, Find="{", Replace=" ", RecursiveReplace=False)
rep_19 = ReplaceText(Text=rep_18, Find="}", Replace=" ", RecursiveReplace=False)

concat_10 = Concatenate(FragmentA=panel_49, FragmentB=",", FragmentC=rep_19)

panel_51 = Panel(concat_10)

panel_52 = Panel("NODE LIST")
panel_53 = Panel([panel_30, panel_36, panel_33, panel_39, panel_45, panel_48, panel_51, panel_42])
